% Simulink data dictionary applicationDD.sldd

ACE11C_ACE10x_11C = Simulink.Bus()
  ACE11C_ACE10x_GEARING_APPLIED: single
  ACE11C_ACE10x_GEARING_APP_F_C: boolean
  ACE11C_ACE10x_PPROG: uint8
  ACE11C_ACE10x_PPROG_FAILURE: boolean
  ACE11C_ACE10x_RAM_POS_C_FAILURE: boolean
  ACE11C_ACE10x_RAM_POS_C: single
  ACE11C_ACE10x_MODE_C: uint8
  ACE11C_ACE10x_ROLL_POS_C_FAILURE: boolean
  ACE11C_ACE10x_ROLL_POS_C: single
  ACE11C_ACE10x_INC_DEMAND_FAIL: boolean
  ACE11C_ACE10x_TBI_FLAG_APP: boolean
  ACE11C_ACE10x_SPD_C_FAILURE: boolean
  ACE11C_ACE10x_DELTA_P_FAILURE: boolean
  ACE11C_ACE10x_DELTA_P_C: single
  ACE11C_ACE10x_WOW1_C: boolean
  ACE11C_ACE10x_WOW2_C: boolean
  ACE11C_ACE10x_SPD_C: uint8

ACE9C_ACE8x_9C = Simulink.Bus()
  ACE9C_ACE8x_GEARING_APPLIED: single
  ACE9C_ACE8x_GEARING_APP_F_C: boolean
  ACE9C_ACE8x_PPROG: uint8
  ACE9C_ACE8x_PPROG_FAILURE: boolean
  ACE9C_ACE8x_RAM_POS_C_FAILURE: boolean
  ACE9C_ACE8x_RAM_POS_C: single
  ACE9C_ACE8x_MODE_C: uint8
  ACE9C_ACE8x_ROLL_POS_C_FAILURE: boolean
  ACE9C_ACE8x_ROLL_POS_C: single
  ACE9C_ACE8x_INC_DEMAND_FAIL: boolean
  ACE9C_ACE8x_TBI_FLAG_APP: single
  ACE9C_ACE8x_SPD_C_FAILURE: boolean
  ACE9C_ACE8x_DELTA_P_FAILURE: boolean
  ACE9C_ACE8x_DELTA_P_C: single
  ACE9C_ACE8x_WOW1_C: boolean
  ACE9C_ACE8x_WOW2_C: boolean
  ACE9C_ACE8x_SPD_C: uint8

AECU10_AEMACE10_1 = Simulink.Bus()
  AECU10_AEMACE10_BRAKE1_CURR: single
  AECU10_AEMACE10_BRAKE1_TEMP: single
  AECU10_AEMACE10_BRAKE1_STATUS: boolean
  AECU10_AEMACE10_BRAKE2_CURR: single
  AECU10_AEMACE10_BRAKE2_TEMP: single
  AECU10_AEMACE10_BRAKE2_STATUS: boolean
  AECU10_AEMACE10_BUS_VOLTAGE: single
  AECU10_AEMACE10_BUS_CURR: single
  AECU10_AEMACE10_WINDING_TEMP1: single
  AECU10_AEMACE10_WINDING_TEMP2: single
  AECU10_AEMACE10_ACTUATOR_SPD: single
  AECU10_AEMACE10_ECU_TEMP: single
  AECU10_AEMACE10_EDM_TEMP: single
  AECU10_AEMACE10_EDM_CURR: single
  AECU10_AEMACE10_EDM_STATUS: boolean
  AECU10_AEMACE10_ACTUATOR_FORCE: single
  AECU10_AEMACE10_ECU_MODE: uint8
  AECU10_AEMACE10_ECU_SUBMODE: uint8
  AECU10_AEMACE10_ECU_FUNC_SEL: boolean
  AECU10_AEMACE10_ECU_ENGINEERING_FUNC: boolean
  AECU10_AEMACE10_CBIT_RESULT: boolean
  AECU10_AEMACE10_CBIT_TIMEOUT: boolean
  AECU10_AEMACE10_CBIT_SYSTEM_FAILURE: boolean
  AECU10_AEMACE10_CBIT_OPERATIONAL_FAILURE: boolean
  AECU10_AEMACE10_CBIT_FUNCTIONAL_FAILURE: boolean
  AECU10_AEMACE10_CBIT_MINOR_FAILURE: boolean
  AECU10_AEMACE10_IBIT_RESULT: boolean
  AECU10_AEMACE10_IBIT_TIMEOUT: boolean
  AECU10_AEMACE10_IBIT_SYSTEM_FAILURE: boolean
  AECU10_AEMACE10_IBIT_OPERATIONAL_FAILURE: boolean
  AECU10_AEMACE10_IBIT_FUNCTIONAL_FAILURE: boolean
  AECU10_AEMACE10_IBIT_MINOR_FAILURE: boolean
  AECU10_AEMACE10_PBIT_RESULT: boolean
  AECU10_AEMACE10_PBIT_TIMEOUT: boolean
  AECU10_AEMACE10_PBIT_SYSTEM_FAILURE: boolean
  AECU10_AEMACE10_PBIT_OPERATIONAL_FAILURE: boolean
  AECU10_AEMACE10_PBIT_FUNCTIONAL_FAILURE: boolean
  AECU10_AEMACE10_PBIT_MINOR_FAILURE: boolean

AECU8_AEMACE8_1 = Simulink.Bus()
  AECU8_AEMACE8_BRAKE1_CURR: single
  AECU8_AEMACE8_BRAKE1_TEMP: single
  AECU8_AEMACE8_BRAKE1_STATUS: boolean
  AECU8_AEMACE8_BRAKE2_CURR: single
  AECU8_AEMACE8_BRAKE2_TEMP: single
  AECU8_AEMACE8_BRAKE2_STATUS: boolean
  AECU8_AEMACE8_BUS_VOLTAGE: single
  AECU8_AEMACE8_BUS_CURR: single
  AECU8_AEMACE8_WINDING_TEMP1: single
  AECU8_AEMACE8_WINDING_TEMP2: single
  AECU8_AEMACE8_ACTUATOR_SPD: single
  AECU8_AEMACE8_ECU_TEMP: single
  AECU8_AEMACE8_EDM_TEMP: single
  AECU8_AEMACE8_EDM_CURR: single
  AECU8_AEMACE8_EDM_STATUS: boolean
  AECU8_AEMACE8_ACTUATOR_FORCE: single
  AECU8_AEMACE8_ECU_MODE: uint8
  AECU8_AEMACE8_ECU_SUBMODE: uint8
  AECU8_AEMACE8_ECU_FUNC_SEL: boolean
  AECU8_AEMACE8_ECU_ENGINEERING_FUNC: boolean
  AECU8_AEMACE8_CBIT_RESULT: boolean
  AECU8_AEMACE8_CBIT_TIMEOUT: boolean
  AECU8_AEMACE8_CBIT_SYSTEM_FAILURE: boolean
  AECU8_AEMACE8_CBIT_OPERATIONAL_FAILURE: boolean
  AECU8_AEMACE8_CBIT_FUNCTIONAL_FAILURE: boolean
  AECU8_AEMACE8_CBIT_MINOR_FAILURE: boolean
  AECU8_AEMACE8_IBIT_RESULT: boolean
  AECU8_AEMACE8_IBIT_TIMEOUT: boolean
  AECU8_AEMACE8_IBIT_SYSTEM_FAILURE: boolean
  AECU8_AEMACE8_IBIT_OPERATIONAL_FAILURE: boolean
  AECU8_AEMACE8_IBIT_FUNCTIONAL_FAILURE: boolean
  AECU8_AEMACE8_IBIT_MINOR_FAILURE: boolean
  AECU8_AEMACE8_PBIT_RESULT: boolean
  AECU8_AEMACE8_PBIT_TIMEOUT: boolean
  AECU8_AEMACE8_PBIT_SYSTEM_FAILURE: boolean
  AECU8_AEMACE8_PBIT_OPERATIONAL_FAILURE: boolean
  AECU8_AEMACE8_PBIT_FUNCTIONAL_FAILURE: boolean
  AECU8_AEMACE8_PBIT_MINOR_FAILURE: boolean

AEMACE10_AECU10_1 = Simulink.Bus()
  AEMACE10_AECU10_OPERATIONAL_MODE_CMD: uint8
  AEMACE10_AECU10_WOW1: boolean
  AEMACE10_AECU10_WOW2: boolean
  AEMACE10_AECU10_BRAKE_CMD_AWARENESS: boolean
  AEMACE10_AECU10_HB: boolean
  AEMACE10_AECU10_ACTUATOR_SPEED_CMD: single
  AEMACE10_AECU10_DELTAP_FAILURE: boolean

AEMACE8_AECU8_1 = Simulink.Bus()
  AEMACE8_AECU8_OPERATIONAL_MODE_CMD: uint8
  AEMACE8_AECU8_WOW1: boolean
  AEMACE8_AECU8_WOW2: boolean
  AEMACE8_AECU8_BRAKE_CMD_AWARENESS: boolean
  AEMACE8_AECU8_HB: boolean
  AEMACE8_AECU8_ACTUATOR_SPEED_CMD: single
  AEMACE8_AECU8_DELTAP_FAILURE: boolean

BUCU1_FCC1 = Simulink.Bus()
  BUCU1_FCC1_LHCURRENTCMD: single
  BUCU1_FCC1_LHINPUTCMD: single
  BUCU1_FCC1_PILOTCOLUMNPOSITION: single
  BUCU1_FCC1_LHELEVPOSITION: single
  BUCU1_FCC1_PILOTCOLUMNPOSITIONVALID: boolean
  BUCU1_FCC1_LHSPEEDINPUTVALID: boolean
  BUCU1_FCC1_LHGEARINGVALID: boolean
  BUCU1_FCC1_LHELEVPOSITIONVALID: boolean
  BUCU1_FCC1_LHCONTROLLOOPDEMAND: single
  BUCU1_FCC1_LHACTPOSVSCMDVALID: boolean
  BUCU1_FCC1_LHACTCMDVSCURRENTVALID: boolean
  BUCU1_FCC1_LHACTCTLVSMONLOOPVALID: boolean
  BUCU1_FCC1_LHHYDPRESSVALID: boolean
  BUCU1_FCC1_LHPOWERVALID: boolean
  BUCU1_FCC1_LHBUCUACTIVE: boolean
  BUCU1_FCC1_LHBUCUMANUALMODEACTIVE: boolean

BUCU2_FCC2 = Simulink.Bus()
  BUCU2_FCC2_RHCURRENTCMD: single
  BUCU2_FCC2_RHINPUTCMD: single
  BUCU2_FCC2_COPILOTCOLUMNPOSITION: single
  BUCU2_FCC2_RHELEVPOSITION: single
  BUCU2_FCC2_COPILOTCOLUMNPOSITIONVALID: boolean
  BUCU2_FCC2_RHSPEEDINPUTVALID: boolean
  BUCU2_FCC2_RHGEARINGVALID: boolean
  BUCU2_FCC2_RHELEVPOSITIONVALID: boolean
  BUCU2_FCC2_RHCONTROLLOOPDEMAND: single
  BUCU2_FCC2_RHACTPOSVSCMDVALID: boolean
  BUCU2_FCC2_RHACTCMDVSCURRENTVALID: boolean
  BUCU2_FCC2_RHACTCTLVSMONLOOPVALID: boolean
  BUCU2_FCC2_RHHYDPRESSVALID: boolean
  BUCU2_FCC2_RHPOWERVALID: boolean
  BUCU2_FCC2_RHBUCUACTIVE: boolean
  BUCU2_FCC2_RHBUCUMANUALMODEACTIVE: boolean

BUCU3_FCC1 = Simulink.Bus()
  BUCU3_FCC1_LHCURRENTCMD: single
  BUCU3_FCC1_LHINPUTCMD: single
  BUCU3_FCC1_PILOTWHEELPOSITION: single
  BUCU3_FCC1_LHELEVPOSITION: single
  BUCU3_FCC1_PILOTWHEELPOSITIONVALID: boolean
  BUCU3_FCC1_LHSPEEDINPUTVALID: boolean
  BUCU3_FCC1_LHGEARINGVALID: boolean
  BUCU3_FCC1_LHELEVPOSITIONVALID: boolean
  BUCU3_FCC1_LHCONTROLLOOPDEMAND: single
  BUCU3_FCC1_LHACTPOSVSCMDVALID: boolean
  BUCU3_FCC1_LHACTCMDVSCURRENTVALID: boolean
  BUCU3_FCC1_LHACTCTLVSMONLOOPVALID: boolean
  BUCU3_FCC1_LHHYDPRESSVALID: boolean
  BUCU3_FCC1_LHPOWERVALID: boolean
  BUCU3_FCC1_LHBUCUACTIVE: boolean
  BUCU3_FCC1_LHBUCUMANUALMODEACTIVE: boolean

BUCU4_FCC2 = Simulink.Bus()
  BUCU4_FCC2_RHCURRENTCMD: single
  BUCU4_FCC2_RHINPUTCMD: single
  BUCU4_FCC2_COPILOTWHEELPOSITION: single
  BUCU4_FCC2_RHELEVPOSITION: single
  BUCU4_FCC2_COPILOTWHEELPOSITIONVALID: boolean
  BUCU4_FCC2_RHSPEEDINPUTVALID: boolean
  BUCU4_FCC2_RHGEARINGVALID: boolean
  BUCU4_FCC2_RHELEVPOSITIONVALID: boolean
  BUCU4_FCC2_RHCONTROLLOOPDEMAND: single
  BUCU4_FCC2_RHACTPOSVSCMDVALID: boolean
  BUCU4_FCC2_RHACTCMDVSCURRENTVALID: boolean
  BUCU4_FCC2_RHACTCTLVSMONLOOPVALID: boolean
  BUCU4_FCC2_RHHYDPRESSVALID: boolean
  BUCU4_FCC2_RHPOWERVALID: boolean
  BUCU4_FCC2_RHBUCUACTIVE: boolean
  BUCU4_FCC2_RHBUCUMANUALMODEACTIVE: boolean

FCC1_ACExxxA_C1_A = Simulink.Bus()
  FCC1_ACExxxA_GEARING_ROLL: single
  FCC1_ACExxxA_GEARING_ROLL_FAIL: boolean
  FCC1_ACExxxA_ROLL_INCREMENTAL_DEMAND_FAIL: boolean
  FCC1_ACExxxA_TBI_FAIL: boolean
  FCC1_ACExxxA_WHEEL_POS_1_FAIL: boolean
  FCC1_ACExxxA_SUR_POS_1_AIL_FAIL: boolean
  FCC1_ACExxxA_TBI_LH: single
  FCC1_ACExxxA_ROLL_INCREMENTAL_DEM_LH: single
  FCC1_ACExxxA_TBI_RH: single
  FCC1_ACExxxA_WHEEL_POS_1: single
  FCC1_ACExxxA_SUR_POS_1_AIL: single
  FCC1_ACExxxA_ROLL_INCREMENTAL_DEM_RH: single

FCC1_TC_TX_11_SPOILER_OUTER = Simulink.Bus()
  FCC1_ACExx_GEARING_SPO_OUTER: single
  FCC1_ACExx_GEARING_SPO_OUTER_LH_FAIL: boolean
  FCC1_ACExx_INCREMENTAL_DEM_SPO_OUTER: single
  FCC1_ACExx_INCREMENTAL_DEM_SPO_OUTER_FAIL: boolean
  FCC1_ACExx_TBI_SPO_OUTER_FAIL: boolean
  FCC1_ACExx_TBI_SPO_OUTER_LH: single
  FCC1_ACExx_TBI_SPO_OUTER_RH: single
  FCC1_WACL_DEM_LH: single
  FCC1_WACL_DEM_RH: single

FCC1_TC_TX_12_SPOILER_INNER = Simulink.Bus()
  FCC1_ACExx_GEARING_SPO_INNER: single
  FCC1_ACExx_GEARING_SPO_INNER_LH_FAIL: boolean
  FCC1_ACExx_INCREMENTAL_DEM_SPO_INNER: single
  FCC1_ACExx_INCREMENTAL_DEM_SPO_INNER_FAIL: boolean
  FCC1_ACExx_TBI_SPO_INNER_FAIL: boolean
  FCC1_ACExx_TBI_SPO_INNER_LH: single
  FCC1_ACExx_TBI_SPO_INNER_RH: single
  FCC1_WACL_DEM_LH: single
  FCC1_WACL_DEM_RH: single

FCC2_ACExxxA_M_A = Simulink.Bus()
  FCC2_ACExxxA_SUR_POS_2_AIL_FAIL: boolean
  FCC2_ACExxxA_SUR_POS_2_AIL: single
  FCC2_ACExxxA_GEARING_ROLL_HB: boolean
  FCC2_ACExxxA_TBI_HB: boolean
  FCC2_ACExxxA_INCREMENTAL_DEM_HB: boolean
  FCC2_ACExxxA_WHEEL_POS_2_FAIL: boolean
  FCC2_ACExxxA_WHEEL_POS_2: single

FCC2_TC_TX_11_SPOILER_OUTER_HB = Simulink.Bus()
  FCC2_TC_TX_12_GEARING_SPO_OUTER_HB: boolean
  FCC2_TC_TX_12_TBI_SPO_OUTER_HB: boolean
  FCC2_TC_TX_12_INCREMENTAL_DEM_SPO_OUTER_HB: boolean

FCC2_TC_TX_12_SPOILER_INNER_HB = Simulink.Bus()
  FCC2_TC_TX_12_GEARING_SPO_INNER_HB: boolean
  FCC2_TC_TX_12_TBI_SPO_INNER_HB: boolean
  FCC2_TC_TX_12_INCREMENTAL_DEM_SPO_INNER_HB: boolean

SECU1_SEMACE1_1 = Simulink.Bus()
  SECU1_SEMACE1_BRAKE1_CURR: single
  SECU1_SEMACE1_BRAKE1_TEMP: single
  SECU1_SEMACE1_BRAKE1_STATUS: boolean
  SECU1_SEMACE1_BRAKE2_CURR: single
  SECU1_SEMACE1_BRAKE2_TEMP: single
  SECU1_SEMACE1_BRAKE2_STATUS: boolean
  SECU1_SEMACE1_BUS_VOLTAGE: single
  SECU1_SEMACE1_BUS_CURR: single
  SECU1_SEMACE1_WINDING_TEMP1: single
  SECU1_SEMACE1_WINDING_TEMP2: single
  SECU1_SEMACE1_ACTUATOR_SPD: single
  SECU1_SEMACE1_ECU_TEMP: single
  SECU1_SEMACE1_EDM_TEMP: single
  SECU1_SEMACE1_EDM_CURR: single
  SECU1_SEMACE1_EDM_STATUS: boolean
  SECU1_SEMACE1_ACTUATOR_FORCE: single
  SECU1_SEMACE1_ECU_MODE: uint8
  SECU1_SEMACE1_ECU_SUBMODE: uint8
  SECU1_SEMACE1_ECU_FUNC_SEL: boolean
  SECU1_SEMACE1_ECU_ENGINEERING_FUNC: boolean
  SECU1_SEMACE1_CBIT_RESULT: boolean
  SECU1_SEMACE1_CBIT_TIMEOUT: boolean
  SECU1_SEMACE1_CBIT_SYSTEM_FAILURE: boolean
  SECU1_SEMACE1_CBIT_OPERATIONAL_FAILURE: boolean
  SECU1_SEMACE1_CBIT_FUNCTIONAL_FAILURE: boolean
  SECU1_SEMACE1_CBIT_MINOR_FAILURE: boolean
  SECU1_SEMACE1_IBIT_RESULT: boolean
  SECU1_SEMACE1_IBIT_TIMEOUT: boolean
  SECU1_SEMACE1_IBIT_SYSTEM_FAILURE: boolean
  SECU1_SEMACE1_IBIT_OPERATIONAL_FAILURE: boolean
  SECU1_SEMACE1_IBIT_FUNCTIONAL_FAILURE: boolean
  SECU1_SEMACE1_IBIT_MINOR_FAILURE: boolean
  SECU1_SEMACE1_PBIT_RESULT: boolean
  SECU1_SEMACE1_PBIT_TIMEOUT: boolean
  SECU1_SEMACE1_PBIT_SYSTEM_FAILURE: boolean
  SECU1_SEMACE1_PBIT_OPERATIONAL_FAILURE: boolean
  SECU1_SEMACE1_PBIT_FUNCTIONAL_FAILURE: boolean
  SECU1_SEMACE1_PBIT_MINOR_FAILURE: boolean

SECU2_SEMACE2_1 = Simulink.Bus()
  SECU2_SEMACE2_BRAKE1_CURR: single
  SECU2_SEMACE2_BRAKE1_TEMP: single
  SECU2_SEMACE2_BRAKE1_STATUS: boolean
  SECU2_SEMACE2_BRAKE2_CURR: single
  SECU2_SEMACE2_BRAKE2_TEMP: single
  SECU2_SEMACE2_BRAKE2_STATUS: boolean
  SECU2_SEMACE2_BUS_VOLTAGE: single
  SECU2_SEMACE2_BUS_CURR: single
  SECU2_SEMACE2_WINDING_TEMP1: single
  SECU2_SEMACE2_WINDING_TEMP2: single
  SECU2_SEMACE2_ACTUATOR_SPD: single
  SECU2_SEMACE2_ECU_TEMP: single
  SECU2_SEMACE2_EDM_TEMP: single
  SECU2_SEMACE2_EDM_CURR: single
  SECU2_SEMACE2_EDM_STATUS: boolean
  SECU2_SEMACE2_ACTUATOR_FORCE: single
  SECU2_SEMACE2_ECU_MODE: uint8
  SECU2_SEMACE2_ECU_SUBMODE: uint8
  SECU2_SEMACE2_ECU_FUNC_SEL: boolean
  SECU2_SEMACE2_ECU_ENGINEERING_FUNC: boolean
  SECU2_SEMACE2_CBIT_RESULT: boolean
  SECU2_SEMACE2_CBIT_TIMEOUT: boolean
  SECU2_SEMACE2_CBIT_SYSTEM_FAILURE: boolean
  SECU2_SEMACE2_CBIT_OPERATIONAL_FAILURE: boolean
  SECU2_SEMACE2_CBIT_FUNCTIONAL_FAILURE: boolean
  SECU2_SEMACE2_CBIT_MINOR_FAILURE: boolean
  SECU2_SEMACE2_IBIT_RESULT: boolean
  SECU2_SEMACE2_IBIT_TIMEOUT: boolean
  SECU2_SEMACE2_IBIT_SYSTEM_FAILURE: boolean
  SECU2_SEMACE2_IBIT_OPERATIONAL_FAILURE: boolean
  SECU2_SEMACE2_IBIT_FUNCTIONAL_FAILURE: boolean
  SECU2_SEMACE2_IBIT_MINOR_FAILURE: boolean
  SECU2_SEMACE2_PBIT_RESULT: boolean
  SECU2_SEMACE2_PBIT_TIMEOUT: boolean
  SECU2_SEMACE2_PBIT_SYSTEM_FAILURE: boolean
  SECU2_SEMACE2_PBIT_OPERATIONAL_FAILURE: boolean
  SECU2_SEMACE2_PBIT_FUNCTIONAL_FAILURE: boolean
  SECU2_SEMACE2_PBIT_MINOR_FAILURE: boolean

SECU3_SEMACE3_1 = Simulink.Bus()
  SECU3_SEMACE3_BRAKE1_CURR: single
  SECU3_SEMACE3_BRAKE1_TEMP: single
  SECU3_SEMACE3_BRAKE1_STATUS: boolean
  SECU3_SEMACE3_BRAKE2_CURR: single
  SECU3_SEMACE3_BRAKE2_TEMP: single
  SECU3_SEMACE3_BRAKE2_STATUS: boolean
  SECU3_SEMACE3_BUS_VOLTAGE: single
  SECU3_SEMACE3_BUS_CURR: single
  SECU3_SEMACE3_WINDING_TEMP1: single
  SECU3_SEMACE3_WINDING_TEMP2: single
  SECU3_SEMACE3_ACTUATOR_SPD: single
  SECU3_SEMACE3_ECU_TEMP: single
  SECU3_SEMACE3_EDM_TEMP: single
  SECU3_SEMACE3_EDM_CURR: single
  SECU3_SEMACE3_EDM_STATUS: boolean
  SECU3_SEMACE3_ACTUATOR_FORCE: single
  SECU3_SEMACE3_ECU_MODE: uint8
  SECU3_SEMACE3_ECU_SUBMODE: uint8
  SECU3_SEMACE3_ECU_FUNC_SEL: boolean
  SECU3_SEMACE3_ECU_ENGINEERING_FUNC: boolean
  SECU3_SEMACE3_CBIT_RESULT: boolean
  SECU3_SEMACE3_CBIT_TIMEOUT: boolean
  SECU3_SEMACE3_CBIT_SYSTEM_FAILURE: boolean
  SECU3_SEMACE3_CBIT_OPERATIONAL_FAILURE: boolean
  SECU3_SEMACE3_CBIT_FUNCTIONAL_FAILURE: boolean
  SECU3_SEMACE3_CBIT_MINOR_FAILURE: boolean
  SECU3_SEMACE3_IBIT_RESULT: boolean
  SECU3_SEMACE3_IBIT_TIMEOUT: boolean
  SECU3_SEMACE3_IBIT_SYSTEM_FAILURE: boolean
  SECU3_SEMACE3_IBIT_OPERATIONAL_FAILURE: boolean
  SECU3_SEMACE3_IBIT_FUNCTIONAL_FAILURE: boolean
  SECU3_SEMACE3_IBIT_MINOR_FAILURE: boolean
  SECU3_SEMACE3_PBIT_RESULT: boolean
  SECU3_SEMACE3_PBIT_TIMEOUT: boolean
  SECU3_SEMACE3_PBIT_SYSTEM_FAILURE: boolean
  SECU3_SEMACE3_PBIT_OPERATIONAL_FAILURE: boolean
  SECU3_SEMACE3_PBIT_FUNCTIONAL_FAILURE: boolean
  SECU3_SEMACE3_PBIT_MINOR_FAILURE: boolean

SECU4_SEMACE4_1 = Simulink.Bus()
  SECU4_SEMACE4_BRAKE1_CURR: single
  SECU4_SEMACE4_BRAKE1_TEMP: single
  SECU4_SEMACE4_BRAKE1_STATUS: boolean
  SECU4_SEMACE4_BRAKE2_CURR: single
  SECU4_SEMACE4_BRAKE2_TEMP: single
  SECU4_SEMACE4_BRAKE2_STATUS: boolean
  SECU4_SEMACE4_BUS_VOLTAGE: single
  SECU4_SEMACE4_BUS_CURR: single
  SECU4_SEMACE4_WINDING_TEMP1: single
  SECU4_SEMACE4_WINDING_TEMP2: single
  SECU4_SEMACE4_ACTUATOR_SPD: single
  SECU4_SEMACE4_ECU_TEMP: single
  SECU4_SEMACE4_EDM_TEMP: single
  SECU4_SEMACE4_EDM_CURR: single
  SECU4_SEMACE4_EDM_STATUS: boolean
  SECU4_SEMACE4_ACTUATOR_FORCE: single
  SECU4_SEMACE4_ECU_MODE: uint8
  SECU4_SEMACE4_ECU_SUBMODE: uint8
  SECU4_SEMACE4_ECU_FUNC_SEL: boolean
  SECU4_SEMACE4_ECU_ENGINEERING_FUNC: boolean
  SECU4_SEMACE4_CBIT_RESULT: boolean
  SECU4_SEMACE4_CBIT_TIMEOUT: boolean
  SECU4_SEMACE4_CBIT_SYSTEM_FAILURE: boolean
  SECU4_SEMACE4_CBIT_OPERATIONAL_FAILURE: boolean
  SECU4_SEMACE4_CBIT_FUNCTIONAL_FAILURE: boolean
  SECU4_SEMACE4_CBIT_MINOR_FAILURE: boolean
  SECU4_SEMACE4_IBIT_RESULT: boolean
  SECU4_SEMACE4_IBIT_TIMEOUT: boolean
  SECU4_SEMACE4_IBIT_SYSTEM_FAILURE: boolean
  SECU4_SEMACE4_IBIT_OPERATIONAL_FAILURE: boolean
  SECU4_SEMACE4_IBIT_FUNCTIONAL_FAILURE: boolean
  SECU4_SEMACE4_IBIT_MINOR_FAILURE: boolean
  SECU4_SEMACE4_PBIT_RESULT: boolean
  SECU4_SEMACE4_PBIT_TIMEOUT: boolean
  SECU4_SEMACE4_PBIT_SYSTEM_FAILURE: boolean
  SECU4_SEMACE4_PBIT_OPERATIONAL_FAILURE: boolean
  SECU4_SEMACE4_PBIT_FUNCTIONAL_FAILURE: boolean
  SECU4_SEMACE4_PBIT_MINOR_FAILURE: boolean

SEMACE1_SECU1_1 = Simulink.Bus()
  SEMACE1_SECU1_OPERATIONAL_MODE_CMD: uint8
  SEMACE1_SECU1_WOW1: boolean
  SEMACE1_SECU1_WOW2: boolean
  SEMACE1_SECU1_BRAKE_CMD_AWARENESS: boolean
  SEMACE1_SECU1_HB: boolean
  SEMACE1_SECU1_ACTUATOR_SPEED_CMD: single
  SEMACE1_SECU1_DELTAP_FAILURE: boolean

SEMACE1_SECU1_2 = Simulink.Bus()
  SEMACE1_SECU1_OPERATIONAL_MODE_CMD: uint8
  SEMACE1_SECU1_WOW1: boolean
  SEMACE1_SECU1_WOW2: boolean
  SEMACE1_SECU1_BRAKE_CMD_AWARENESS: boolean
  SEMACE1_SECU1_HB: boolean
  SEMACE1_SECU1_ACTUATOR_SPEED_CMD: single
  SEMACE1_SECU1_DELTAP_FAILURE: boolean

SEMACE2_SECU2_1 = Simulink.Bus()
  SEMACE2_SECU2_OPERATIONAL_MODE_CMD: uint8
  SEMACE2_SECU2_WOW1: boolean
  SEMACE2_SECU2_WOW2: boolean
  SEMACE2_SECU2_BRAKE_CMD_AWARENESS: boolean
  SEMACE2_SECU2_HB: boolean
  SEMACE2_SECU2_ACTUATOR_SPEED_CMD: single
  SEMACE2_SECU2_DELTAP_FAILURE: boolean

SEMACE2_SECU2_2 = Simulink.Bus()
  SEMACE2_SECU2_OPERATIONAL_MODE_CMD: uint8
  SEMACE2_SECU2_WOW1: boolean
  SEMACE2_SECU2_WOW2: boolean
  SEMACE2_SECU2_BRAKE_CMD_AWARENESS: boolean
  SEMACE2_SECU2_HB: boolean
  SEMACE2_SECU2_ACTUATOR_SPEED_CMD: single
  SEMACE2_SECU2_DELTAP_FAILURE: boolean

SEMACE3_SECU3_1 = Simulink.Bus()
  SEMACE3_SECU3_OPERATIONAL_MODE_CMD: uint8
  SEMACE3_SECU3_WOW1: boolean
  SEMACE3_SECU3_WOW2: boolean
  SEMACE3_SECU3_BRAKE_CMD_AWARENESS: boolean
  SEMACE3_SECU3_HB: boolean
  SEMACE3_SECU3_ACTUATOR_SPEED_CMD: single
  SEMACE3_SECU3_DELTAP_FAILURE: boolean

SEMACE3_SECU3_2 = Simulink.Bus()
  SEMACE3_SECU3_OPERATIONAL_MODE_CMD: uint8
  SEMACE3_SECU3_WOW1: boolean
  SEMACE3_SECU3_WOW2: boolean
  SEMACE3_SECU3_BRAKE_CMD_AWARENESS: boolean
  SEMACE3_SECU3_HB: boolean
  SEMACE3_SECU3_ACTUATOR_SPEED_CMD: single
  SEMACE3_SECU3_DELTAP_FAILURE: boolean

SEMACE4_SECU4_1 = Simulink.Bus()
  SEMACE4_SECU4_OPERATIONAL_MODE_CMD: uint8
  SEMACE4_SECU4_WOW1: boolean
  SEMACE4_SECU4_WOW2: boolean
  SEMACE4_SECU4_BRAKE_CMD_AWARENESS: boolean
  SEMACE4_SECU4_HB: boolean
  SEMACE4_SECU4_ACTUATOR_SPEED_CMD: single
  SEMACE4_SECU4_DELTAP_FAILURE: boolean

SEMACE4_SECU4_2 = Simulink.Bus()
  SEMACE4_SECU4_OPERATIONAL_MODE_CMD: uint8
  SEMACE4_SECU4_WOW1: boolean
  SEMACE4_SECU4_WOW2: boolean
  SEMACE4_SECU4_BRAKE_CMD_AWARENESS: boolean
  SEMACE4_SECU4_HB: boolean
  SEMACE4_SECU4_ACTUATOR_SPEED_CMD: single
  SEMACE4_SECU4_DELTAP_FAILURE: boolean

TC_FCC1_RX_11 = Simulink.Bus()
  SEMACE1_FCC1xD2CU_GEARING_APPLIED: single
  SEMACE1_FCC1xD2CU_SPD: uint8
  SEMACE1_FCC1xD2CU_SPD_FAILURE: boolean
  SEMACE1_FCC1xD2CU_GEARING_FAIL: boolean
  SEMACE1_FCC1xD2CU_GEARING_FLAG: boolean
  SEMACE1_FCC1xD2CU_SEMACE1_MODE: uint8
  SEMACE1_FCC1xD2CU_RAM_POS: single
  SEMACE1_FCC1xD2CU_RAM_POS_FAILURE: boolean
  SEMACE1_FCC1xD2CU_ROLL_POS: single
  SEMACE1_FCC1xD2CU_ROLL_POS_FAILURE: boolean
  SEMACE1_FCC1xD2CU_FCC_ARINC1_ERR: boolean
  SEMACE1_FCC1xD2CU_IBIT_STATUS_C: uint8
  SEMACE1_FCC1xD2CU_IBIT_STATUS_M: uint8
  SEMACE3_FCC1xD2CU_GEARING_APPLIED: single
  SEMACE3_FCC1xD2CU_SPD: uint8
  SEMACE3_FCC1xD2CU_SPD_FAILURE: boolean
  SEMACE3_FCC1xD2CU_GEARING_FAIL: boolean
  SEMACE3_FCC1xD2CU_GEARING_FLAG: boolean
  SEMACE3_FCC1xD2CU_SEMACE3_MODE: uint8
  SEMACE3_FCC1xD2CU_RAM_POS: single
  SEMACE3_FCC1xD2CU_RAM_POS_FAILURE: boolean
  SEMACE3_FCC1xD2CU_ROLL_POS: single
  SEMACE3_FCC1xD2CU_ROLL_POS_FAILURE: boolean
  SEMACE3_FCC1xD2CU_FCC_ARINC1_ERR: boolean
  SEMACE3_FCC1xD2CU_IBIT_STATUS_C: uint8
  SEMACE3_FCC1xD2CU_IBIT_STATUS_M: uint8

TC_FCC1_RX_14 = Simulink.Bus()
  SEMACE2_FCC1xD2CU_GEARING_APPLIED: single
  SEMACE2_FCC1xD2CU_SPD: uint8
  SEMACE2_FCC1xD2CU_SPD_FAILURE: boolean
  SEMACE2_FCC1xD2CU_GEARING_FAIL: boolean
  SEMACE2_FCC1xD2CU_GEARING_FLAG: boolean
  SEMACE2_FCC1xD2CU_SEMACE2_MODE: uint8
  SEMACE2_FCC1xD2CU_RAM_POS: single
  SEMACE2_FCC1xD2CU_RAM_POS_FAILURE: boolean
  SEMACE2_FCC1xD2CU_ROLL_POS: single
  SEMACE2_FCC1xD2CU_ROLL_POS_FAILURE: boolean
  SEMACE2_FCC1xD2CU_FCC_ARINC1_ERR: boolean
  SEMACE2_FCC1xD2CU_IBIT_STATUS_C: uint8
  SEMACE2_FCC1xD2CU_IBIT_STATUS_M: uint8
  SEMACE4_FCC1xD2CU_GEARING_APPLIED: single
  SEMACE4_FCC1xD2CU_SPD: uint8
  SEMACE4_FCC1xD2CU_SPD_FAILURE: boolean
  SEMACE4_FCC1xD2CU_GEARING_FAIL: boolean
  SEMACE4_FCC1xD2CU_GEARING_FLAG: boolean
  SEMACE4_FCC1xD2CU_SEMACE4_MODE: uint8
  SEMACE4_FCC1xD2CU_RAM_POS: single
  SEMACE4_FCC1xD2CU_RAM_POS_FAILURE: boolean
  SEMACE4_FCC1xD2CU_ROLL_POS: single
  SEMACE4_FCC1xD2CU_ROLL_POS_FAILURE: boolean
  SEMACE4_FCC1xD2CU_FCC_ARINC1_ERR: boolean
  SEMACE4_FCC1xD2CU_IBIT_STATUS_C: uint8
  SEMACE4_FCC1xD2CU_IBIT_STATUS_M: uint8

currentFolder = "C:\\Development\\Worksite\\STEP2\\Implementation\\TC-MASTER"
dataAEMACE = struct(rateLimiterDemand=60, rateLimiterTBI=60, rateLimiterIncrementalDemand=60, rateLimiterGearing=0.1)
dataSEMACE = struct(rateLimiterDemand=60, rateLimiterTBI=60, rateLimiterSymmetric=60, rateLimiterGearing=0.1)
designDataFolder = "C:\\Development\\Worksite\\STEP2\\Implementation\\TC-MASTER/Design/designData"
designFolder = "C:\\Development\\Worksite\\STEP2\\Implementation\\TC-MASTER/Design"
designInterfaceFolder = "C:\\Development\\Worksite\\STEP2\\Implementation\\TC-MASTER/Design/Interface"
designInternalInterfaceFolder = "C:\\Development\\Worksite\\STEP2\\Implementation\\TC-MASTER/Design/InternalInterface"
sampleTime = 0.008

AEMACE10_OUTPUT = Simulink.Bus()
  AEMACE10_command: single
  AEMACE10_mode: uint8
  AEMACE10_gearingAPP: single
  AEMACE10_RAM_POS: single
  AEMACE10_ROLL_POS: single
  AEMACE10_SPD_SEL: uint8

AEMACE10_TEST = Simulink.Bus()
  AEMACE10_demandDCL: single
  AEMACE10_RLimitedOffsetFCL: single
  AEMACE10_demand: single
  AEMACE10_RLimitedDemand: single
  AEMACE10_command: single
  AEMACE10_mode: uint8

AEMACE8_OUTPUT = Simulink.Bus()
  AEMACE8_command: single
  AEMACE8_mode: uint8
  AEMACE8_gearingAPP: single
  AEMACE8_RAM_POS: single
  AEMACE8_ROLL_POS: single
  AEMACE8_SPD_SEL: uint8

AEMACE8_TEST = Simulink.Bus()
  AEMACE8_demandDCL: single
  AEMACE8_RLimitedOffsetFCL: single
  AEMACE8_demand: single
  AEMACE8_RLimitedDemand: single
  AEMACE8_command: single
  AEMACE8_mode: uint8

AILERON_ACTUATION_STATE = Simulink.Bus()
  aileronPosition8: single
  aileronMode8: uint8
  aileronPosition10: single
  aileronMode10: uint8

COMMANDED_STATE = Simulink.Bus()
  AEMACE8_ON: boolean
  AEMACE10_ON: boolean
  SEMACE1_ON: boolean
  SEMACE2_ON: boolean
  SEMACE3_ON: boolean
  SEMACE4_ON: boolean
  WEMACE1_ON: boolean
  WEMACE2_ON: boolean
  AEMACE8_STBY: boolean
  AEMACE10_STBY: boolean
  SEMACE1_STBY: boolean
  SEMACE2_STBY: boolean
  SEMACE3_STBY: boolean
  SEMACE4_STBY: boolean
  WEMACE1_STBY: boolean
  WEMACE2_STBY: boolean

SEMACE1_OUTPUT = Simulink.Bus()
  SEMACE1_command: single
  SEMACE1_mode: uint8
  SEMACE1_gearingAPP: single
  SEMACE1_RAM_POS: single
  SEMACE1_ROLL_POS: single
  SEMACE1_SPD_SEL: uint8

SEMACE1_TEST = Simulink.Bus()
  SEMACE1_demandDCL: single
  SEMACE1_RLimitedOffsetFCL: single
  SEMACE1_demand: single
  SEMACE1_RLimitedDemand: single
  SEMACE1_command: single
  SEMACE1_mode: uint8

SEMACE2_OUTPUT = Simulink.Bus()
  SEMACE2_command: single
  SEMACE2_mode: uint8
  SEMACE2_gearingAPP: single
  SEMACE2_RAM_POS: single
  SEMACE2_ROLL_POS: single
  SEMACE2_SPD_SEL: uint8

SEMACE2_TEST = Simulink.Bus()
  SEMACE2_demandDCL: single
  SEMACE2_RLimitedOffsetFCL: single
  SEMACE2_demand: single
  SEMACE2_RLimitedDemand: single
  SEMACE2_command: single
  SEMACE2_mode: uint8

SEMACE3_OUTPUT = Simulink.Bus()
  SEMACE3_command: single
  SEMACE3_mode: uint8
  SEMACE3_gearingAPP: single
  SEMACE3_RAM_POS: single
  SEMACE3_ROLL_POS: single
  SEMACE3_SPD_SEL: uint8

SEMACE3_TEST = Simulink.Bus()
  SEMACE3_demandDCL: single
  SEMACE3_RLimitedOffsetFCL: single
  SEMACE3_demand: single
  SEMACE3_RLimitedDemand: single
  SEMACE3_command: single
  SEMACE3_mode: uint8

SEMACE4_OUTPUT = Simulink.Bus()
  SEMACE4_command: single
  SEMACE4_mode: uint8
  SEMACE4_gearingAPP: single
  SEMACE4_RAM_POS: single
  SEMACE4_ROLL_POS: single
  SEMACE4_SPD_SEL: uint8

SEMACE4_TEST = Simulink.Bus()
  SEMACE4_demandDCL: single
  SEMACE4_RLimitedOffsetFCL: single
  SEMACE4_demand: single
  SEMACE4_RLimitedDemand: single
  SEMACE4_command: single
  SEMACE4_mode: uint8

SPOILER_ACTUATION_STATE = Simulink.Bus()
  spoilerPosition1: single
  spoilerMode1: uint8
  spoilerPosition2: single
  spoilerMode2: uint8
  spoilerPosition3: single
  spoilerMode3: uint8
  spoilerPosition4: single
  spoilerMode4: uint8

WINGLET_ACTUATION_STATE = Simulink.Bus()
  wingletPositionLH: single
  wingletModeLH: uint8
  wingletPositionRH: single
  wingletModeRH: uint8

VECTOR_FLAG = Simulink.Bus()
  FCC1_ACExxxA_C1_RXFAIL: boolean
  FCC1_TC_TX11_SPOILER_OUTER_RXFAIL: boolean
  FCC1_TC_TX12_SPOILER_INNER_RXFAIL: boolean
  FCC2_ACExxxA_M_RXFAIL: boolean
  FCC2_TC_TX11_SPOILER_OUTER_HB_RXFAIL: boolean
  FCC2_TC_TX12_SPOILER_INNER_HB_RXFAIL: boolean
  ACE8C_ACE9x_8C_RXFAIL: boolean
  ACE9C_ACE8x_9C_RXFAIL: boolean
  ACE10C_ACE11x_10C_RXFAIL: boolean
  ACE11C_ACE10x_11C_RXFAIL: boolean
  BUCU3_FCC1_RXFAIL: boolean
  BUCU4_FCC2_RXFAIL: boolean

COCKPIT_INCEPTORS = Simulink.Bus()
  controlWheelLH: single
  controlWheelRH: single
  SPD_SEL: uint8
  flapLever: uint8
  rollTrimPB: single
  pitchTrimPB: single
  controWheelDISC: boolean
  airBrakeENABLE: boolean
  liftDumpENABLE: boolean
  mlaENABLE: boolean
  glaENABLE: boolean
  bankAutopilotENABLE: boolean
  heightAutopilotENABLE: boolean

ACE8C_ACE9x_8C = Simulink.Bus()
  ACE8C_ACE9x_GEARING_APPLIED: single
  ACE8C_ACE9x_GEARING_APP_F_C: boolean
  ACE8C_ACE9x_PPROG: uint8
  ACE8C_ACE9x_PPROG_FAILURE: boolean
  ACE8C_ACE9x_RAM_POS_C_FAILURE: boolean
  ACE8C_ACE9x_RAM_POS_C: single
  ACE8C_ACE9x_MODE_C: uint8
  ACE8C_ACE9x_ROLL_POS_C_FAILURE: boolean
  ACE8C_ACE9x_ROLL_POS_C: single
  ACE8C_ACE9x_INC_DEMAND_FAIL: boolean
  ACE8C_ACE9x_TBI_FLAG_APP: boolean
  ACE8C_ACE9x_SPD_C_FAILURE: boolean
  ACE8C_ACE9x_DELTA_P_FAILURE: boolean
  ACE8C_ACE9x_DELTA_P_C: single
  ACE8C_ACE9x_WOW1_C: boolean
  ACE8C_ACE9x_WOW2_C: boolean
  ACE8C_ACE9x_SPD_C: uint8

ACE10C_ACE11x_10C = Simulink.Bus()
  ACE10C_ACE11x_GEARING_APPLIED: single
  ACE10C_ACE11x_GEARING_APP_F_C: boolean
  ACE10C_ACE11x_PPROG: uint8
  ACE10C_ACE11x_PPROG_FAILURE: boolean
  ACE10C_ACE11x_RAM_POS_C_FAILURE: boolean
  ACE10C_ACE11x_RAM_POS_C: single
  ACE10C_ACE11x_MODE_C: uint8
  ACE10C_ACE11x_ROLL_POS_C_FAILURE: boolean
  ACE10C_ACE11x_ROLL_POS_C: single
  ACE10C_ACE11x_INC_DEMAND_FAIL: boolean
  ACE10C_ACE11x_TBI_FLAG_APP: boolean
  ACE10C_ACE11x_SPD_C_FAILURE: boolean
  ACE10C_ACE11x_DELTA_P_FAILURE: boolean
  ACE10C_ACE11x_DELTA_P_C: single
  ACE10C_ACE11x_WOW1_C: boolean
  ACE10C_ACE11x_WOW2_C: boolean
  ACE10C_ACE11x_SPD_C: uint8

ACE8_FCC1_8 = Simulink.Bus()
  ACE8C_FCCxD2CU_PBIT_TEST_1: boolean
  ACE8C_FCCxD2CU_PBIT_TEST_2: boolean
  ACE8C_FCCxD2CU_PBIT_TEST_3: boolean
  ACE8C_FCCxD2CU_PBIT_TEST_4: boolean
  ACE8C_FCCxD2CU_PBIT_TEST_5: boolean
  ACE8C_FCCxD2CU_PBIT_TEST_6: boolean
  ACE8C_FCCxD2CU_PBIT_TEST_7: boolean
  ACE8C_FCCxD2CU_PBIT_TEST_8: boolean
  ACE8C_FCCxD2CU_IBIT_REQ_C: uint8
  ACE8C_FCCxD2CU_IBIT_STATUS_C: uint8
  ACE8C_FCCxD2CU_IBIT_REQ_M: uint8
  ACE8C_FCCxD2CU_IBIT_STATUS_M: uint8
  ACE8C_FCCxD2CU_MEM_CHK_F: boolean
  ACE8C_FCCxD2CU_INC_DEMAND_FAIL: boolean
  ACE8C_FCCxD2CU_TBI_FAIL: boolean
  ACE8C_FCCxD2CU_EXC_6_C_FLAG: boolean
  ACE8C_FCCxD2CU_EXC_7_C_FLAG: boolean
  ACE8C_FCCxD2CU_EXC_M_FLAG: boolean
  ACE8C_FCCxD2CU_C_VOLTAGE_ERR: boolean
  ACE8C_FCCxD2CU_M_VOLTAGE_ERR: boolean
  ACE8C_FCCxD2CU_TEMP_ERR_C: boolean
  ACE8C_FCCxD2CU_TEMP_ERR_M: boolean
  ACE8C_FCCxD2CU_TEMP_WAR_C: boolean
  ACE8C_FCCxD2CU_TEMP_WAR_M: boolean
  ACE8C_FCCxD2CU_SPD_C_FAILURE: boolean
  ACE8C_FCCxD2CU_SPD_M_FAILURE: boolean
  ACE8C_FCCxD2CU_SW_V: uint8
  ACE8C_FCCxD2CU_ACE_ID: uint8
  ACE8C_FCCxD2CU_ACE8_MODE: uint8
  ACE8C_FCCxD2CU_ACE9_MODE: uint8
  ACE8C_FCCxD2CU_CAN1_ERR: boolean
  ACE8C_FCCxD2CU_CAN2_ERR: boolean
  ACE8C_FCCxD2CU_SOLENOID_CMD_ERR_C: boolean
  ACE8C_FCCxD2CU_SOL_CUR_FLAG: boolean
  ACE8C_FCCxD2CU_MODE_ERR_C: boolean
  ACE8C_FCCxD2CU_CAN_ERR_C: boolean
  ACE8C_FCCxD2CU_CURR_FLAG_C: boolean
  ACE8C_FCCxD2CU_ACTUATOR_MODE: boolean
  ACE8C_FCCxD2CU_BYPASS_ERR_M: boolean
  ACE8C_FCCxD2CU_SERVO_ERR_M: boolean
  ACE8C_FCCxD2CU_PS3_ERR: boolean
  ACE8C_FCCxD2CU_PS3: boolean
  ACE8C_FCCxD2CU_FCC_ARINC1_ERR: boolean
  ACE8C_FCCxD2CU_FBI_ARINC3_ERR: boolean
  ACE8C_FCCxD2CU_FCC_ARINC9_ERR: boolean
  ACE8C_FCCxD2CU_SPD_FAILURE: boolean
  ACE8C_FCCxD2CU_SPD: uint8
  ACE8C_FCCxD2CU_WOW_FAILURE: boolean
  ACE8C_FCCxD2CU_WOW: boolean
  ACE8C_FCCxD2CU_ARINC_ERR_C: boolean
  ACE8C_FCCxD2CU_CARINC5_ERR: boolean
  ACE8C_FCCxD2CU_CARINC6_ERR: boolean
  ACE8C_FCCxD2CU_DP_ERR: boolean
  ACE8C_FCCxD2CU_PPROG_FAILURE: boolean
  ACE8C_FCCxD2CU_GEARING_FLAG: boolean
  ACE8C_FCCxD2CU_GEARING: boolean
  ACE8C_FCCxD2CU_GEARING_APPLIED: single
  ACE8C_FCCxD2CU_FF: single
  ACE8C_FCCxD2CU_FF_FAILURE: uint8
  ACE8C_FCCxD2CU_RAM_POS_FAILURE: boolean
  ACE8C_FCCxD2CU_RAM_POS: single
  ACE8C_FCCxD2CU_ROLL_POS_FAILURE: boolean
  ACE8C_FCCxD2CU_ROLL_POS: single

ACE10_FCC1D2CU_10 = Simulink.Bus()
  ACE10C_FCC1xD2CU_PBIT_TEST_1: boolean
  ACE10C_FCC1xD2CU_PBIT_TEST_2: boolean
  ACE10C_FCC1xD2CU_PBIT_TEST_3: boolean
  ACE10C_FCC1xD2CU_PBIT_TEST_4: boolean
  ACE10C_FCC1xD2CU_PBIT_TEST_5: boolean
  ACE10C_FCC1xD2CU_PBIT_TEST_6: boolean
  ACE10C_FCC1xD2CU_PBIT_TEST_7: boolean
  ACE10C_FCC1xD2CU_PBIT_TEST_8: boolean
  ACE10C_FCC1xD2CU_IBIT_REQ_C: uint8
  ACE10C_FCC1xD2CU_IBIT_STATUS_C: uint8
  ACE10C_FCC1xD2CU_IBIT_REQ_M: uint8
  ACE10C_FCC1xD2CU_IBIT_STATUS_M: uint8
  ACE10C_FCC1xD2CU_MEM_CHK_F: boolean
  ACE10C_FCC1xD2CU_INC_DEMAND_FAIL: boolean
  ACE10C_FCC1xD2CU_TBI_FAIL: boolean
  ACE10C_FCC1xD2CU_EXC_6_C_FLAG: boolean
  ACE10C_FCC1xD2CU_EXC_7_C_FLAG: boolean
  ACE10C_FCC1xD2CU_EXC_M_FLAG: boolean
  ACE10C_FCC1xD2CU_C_VOLTAGE_ERR: boolean
  ACE10C_FCC1xD2CU_M_VOLTAGE_ERR: boolean
  ACE10C_FCC1xD2CU_TEMP_ERR_C: boolean
  ACE10C_FCC1xD2CU_TEMP_ERR_M: boolean
  ACE10C_FCC1xD2CU_TEMP_WAR_C: boolean
  ACE10C_FCC1xD2CU_TEMP_WAR_M: boolean
  ACE10C_FCC1xD2CU_SPD_C_FAILURE: boolean
  ACE10C_FCC1xD2CU_SPD_M_FAILURE: boolean
  ACE10C_FCC1xD2CU_SW_V: uint8
  ACE10C_FCC1xD2CU_ACE_ID: uint8
  ACE10C_FCC1xD2CU_ACE10_MODE: uint8
  ACE10C_FCC1xD2CU_ACE11_MODE: uint8
  ACE10C_FCC1xD2CU_CAN1_ERR: boolean
  ACE10C_FCC1xD2CU_CAN2_ERR: boolean
  ACE10C_FCC1xD2CU_SOLENOID_CMD_ERR_C: boolean
  ACE10C_FCC1xD2CU_SOL_CUR_FLAG: boolean
  ACE10C_FCC1xD2CU_MODE_ERR_C: boolean
  ACE10C_FCC1xD2CU_CAN_ERR_C: boolean
  ACE10C_FCC1xD2CU_CURR_FLAG_C: boolean
  ACE10C_FCC1xD2CU_ACTUATOR_MODE: boolean
  ACE10C_FCC1xD2CU_BYPASS_ERR_M: boolean
  ACE10C_FCC1xD2CU_SERVO_ERR_M: boolean
  ACE10C_FCC1xD2CU_PS3_ERR: boolean
  ACE10C_FCC1xD2CU_PS3: boolean
  ACE10C_FCC1xD2CU_FCC_ARINC1_ERR: boolean
  ACE10C_FCC1xD2CU_FBI_ARINC3_ERR: boolean
  ACE10C_FCC1xD2CU_FCC_ARINC9_ERR: boolean
  ACE10C_FCC1xD2CU_SPD_FAILURE: boolean
  ACE10C_FCC1xD2CU_SPD: uint8
  ACE10C_FCC1xD2CU_WOW_FAILURE: boolean
  ACE10C_FCC1xD2CU_WOW: boolean
  ACE10C_FCC1xD2CU_ARINC_ERR_C: boolean
  ACE10C_FCC1xD2CU_CARINC5_ERR: boolean
  ACE10C_FCC1xD2CU_CARINC6_ERR: boolean
  ACE10C_FCC1xD2CU_DP_ERR: boolean
  ACE10C_FCC1xD2CU_PPROG_FAILURE: boolean
  ACE10C_FCC1xD2CU_GEARING_FLAG: boolean
  ACE10C_FCC1xD2CU_GEARING: boolean
  ACE10C_FCC1xD2CU_GEARING_APPLIED: single
  ACE10C_FCC1xD2CU_FF: single
  ACE10C_FCC1xD2CU_FF_FAILURE: uint8
  ACE10C_FCC1xD2CU_RAM_POS_FAILURE: boolean
  ACE10C_FCC1xD2CU_RAM_POS: single
  ACE10C_FCC1xD2CU_ROLL_POS_FAILURE: boolean
  ACE10C_FCC1xD2CU_ROLL_POS: single

UDP_RX = Simulink.Bus()
  TOGGLE: uint8

UDP_TX = Simulink.Bus()
  AEMACE8_CMD_STATE: boolean
  AEMACE10_CMD_STATE: boolean
  ACE9_CMD_STATE: boolean
  ACE11_CMD_STATE: boolean