% Simulink data dictionary targetDD.sldd
% references sampleTimeDD.sldd
% references busDD.sldd
% references dataAEMACE_DD.sldd
% references dataSEMACE_DD.sldd

SEMACE2_OUTPUT = Simulink.Bus()
  SEMACE2_command: single
  SEMACE2_mode: uint8

SEMACE2_TEST = Simulink.Bus()
  SEMACE2_demandDCL: single
  SEMACE2_RLimitedOffsetFCL: single
  SEMACE2_demand: single
  SEMACE2_RLimitedDemand: single
  SEMACE2_command: single
  SEMACE2_mode: uint8

SEMACE3_OUTPUT = Simulink.Bus()
  SEMACE3_command: single
  SEMACE3_mode: uint8

SEMACE3_TEST = Simulink.Bus()
  SEMACE3_demandDCL: single
  SEMACE3_RLimitedOffsetFCL: single
  SEMACE3_demand: single
  SEMACE3_RLimitedDemand: single
  SEMACE3_command: single
  SEMACE3_mode: uint8

SEMACE4_OUTPUT = Simulink.Bus()
  SEMACE4_command: single
  SEMACE4_mode: uint8

SEMACE4_TEST = Simulink.Bus()
  SEMACE4_demandDCL: single
  SEMACE4_RLimitedOffsetFCL: single
  SEMACE4_demand: single
  SEMACE4_RLimitedDemand: single
  SEMACE4_command: single
  SEMACE4_mode: uint8